# Dynamo graph test.dyn (Dynamo 1.3.0.875)

file_path = Filename("C:\Users\Mostapha\Documents\code\ladybug-tools\dynosaur\test.py")
fromPath = FileObject(file_path)  # "File.FromPath"
readText = File.ReadText(fromPath)
watch = Watch(readText)
python_script_from_string = PythonStringNode(script=readText)
code_block = CodeBlock(x=python_script_from_string) { x[0]; x[1]; }
byPerimeterPoints = Surface.ByPerimeterPoints(code_block.out1)
code_block_2 = CodeBlock { 200; 100; }
byARGB = Color.ByARGB(g=code_block_2.out0, b=code_block_2.out1)
byGeometryColor = Display.Display.ByGeometryColor(byPerimeterPoints, byARGB)
watch_2 = Watch(python_script_from_string)
code_block_3 = CodeBlock { true; }
collect_rooms_and_spaces = Custom[Collect Rooms and Spaces](collect=code_block_3)  # Collect rooms and MEP spaces in the Revit document. Use "Rooms to HBZones" node to convert them to Honeybee zones.
code_block_4 = CodeBlock(x=collect_rooms_and_spaces.rooms) { x[1]; }
rooms_to_hbzones = Custom[Rooms to HBZones](rooms=code_block_4)  # Create Honeybee zones from Revit Rooms or MEPSpaces. This node currently ONLY collects geometrical data from Revit. In the future it will import constructions, materials and MEP data (e.g lighting power density).
byPoints = Polygon.ByPoints(code_block.out0)
